# Grasshopper definition LaserCut-file.gh (Grasshopper 1.0.7)
# plug-ins: Kangaroo2 Components, EleFront

pipeline = GeometryPipeline(
    GroupByLayer=False,
    GroupByType=False,
    IncludeHidden=True,
    IncludeLocked=True,
    LayerFilter="LaserCut::3::Geo",
    NameFilter="*",
    SublayerFiltering=True,
    TypeFilter=1073741848)
lng = ListLength(List=pipeline)  # -> expr("x-1", Length)
edges = BrepEdges(Brep=pipeline)  # -> Naked, Interior, NonManifold
explode = Explode(Curve=edges.Interior, Recursive=True)  # -> Segments, Vertices
explode_2 = Explode(Curve=edges.Naked, Recursive=True)  # -> Segments, Vertices
trim = TrimTree(Tree=simplify(explode.Segments), Depth=lng)
trim_2 = TrimTree(Tree=simplify(explode_2.Segments), Depth=lng)
dupln = RemoveDuplicateLines(Lines=trim, Tolerance=0.01)
dupln_2 = RemoveDuplicateLines(Lines=trim_2, Tolerance=0.01)
button = Button()
attributes = DefineObjectAttributes(Layer="LaserCut::3::Cut")
attributes_2 = DefineObjectAttributes(Layer="LaserCut::3::Engrave")
bake = BakeObjects(Geometry=dupln_2, Attributes=attributes, BakeName="LaserCut::3::Cut", Bake=button)
bake_2 = BakeObjects(Geometry=dupln, Attributes=attributes_2, BakeName="LaserCut::3::Engrave", Bake=button)
